# Grasshopper definition Example_Cluster_Regions_GMM.ghx (Grasshopper 1.0.7)
# plug-ins: MeshEdit Components

# ---- group: Retrieve Points and Areas in a JSON file
mesh = Mesh(<mesh referenced from the Rhino model>)
# Export the topography data
weld = WeldMesh(Mesh=mesh, Angle=3.141592654)  # disabled
explode = MeshExplode(Mesh=weld, Interpolate=False)
area = MeshArea(Mesh=explode)  # -> Area, Centroid
python = GhPythonScript(Dump_Json=Button(), Points=area.Centroid, Areas=area.Area)  # -> out; inputs Dump_Json: Boolean, Points: list of Point3d, Areas: list
# ---------- python: Python ----------
"""
    Saving topography's data in a json file

"""

import os
import Rhino.Geometry as rg
import json

#Create dicts to store the data
X = {}
Y = {}
Z = {}
A = {}

#Loop through the two lists

for i, (pt, area) in enumerate(zip(Points, Areas)):
    X["{}".format(i)] = pt.X
    Y["{}".format(i)] = pt.Y
    Z["{}".format(i)] = pt.Z
    A["{}".format(i)] = area

#Create the dict that will contain all these data and add the data

data = {}
data["X"] = X
data["Y"] = Y
data["Z"] = Z
data["A"] = A

#Locate the current gh folder

gh_canvas = ghenv.Component.OnPingDocument()
folder = os.path.dirname(gh_canvas.FilePath)

#Dump the json file

if Dump_Json:
    with open(os.path.join(folder,'data.json'), 'w') as json_file:
        json.dump(data, json_file, indent = 2)
# ---------- end python ----------

# ---- group: Show
crv = Curve(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)
crv_2 = Curve([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])
crv_3 = Curve(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)

# ---- group: Read the Clustered Data
toggle = BooleanToggle(False)

# ---- group: Read the Clustered Data / Load from JSON file
python_2 = GhPythonScript(Read=toggle)  # -> out, Indices, Cluster_labels
# ---------- python_2: Python ----------
import json
import Rhino.Geometry as rg
import os

#Get current Directory
gh_canvas = ghenv.Component.OnPingDocument()
folder = os.path.dirname(gh_canvas.FilePath)


#Load Json
if Read:
    with open(os.path.join(folder, 'cluster_data.json')) as file:
        Clustered = json.load(file)

#Isolate the labels
    Labels = Clustered['cluster']

    Indices = []
    Cluster_labels = []
#Append in output lists
    for key, value in Labels.items():
        Indices.append(key)
        Cluster_labels.append(value)
# ---------- end python_2 ----------

# ----
# Extract the clusters from the list of points
dam = DataDam(DataA=python_2.Indices, BufferDelay=10000000, BufferMode=0)
dam_2 = DataDam(DataA=python_2.Cluster_labels, BufferDelay=10000000, BufferMode=0)

# ---- group: Read the Clustered Data (continued)
item = ListItem(List=explode, Index=dam, Wrap=True)  # disabled
cset = CreateSet(List=dam_2)  # -> Set, Map; disabled
item_2 = ListItem(List=area.Centroid, Index=dam, Wrap=True)  # disabled
mindex = MemberIndex(Set=cset.Map, Member=cset.Set)  # -> Index, Count
bang = ExplodeTree(Data=mindex.Index)  # -> Branch0, Branch1, Branch2
item_3 = ListItem(List=item_2, Index=bang.Branch0, Wrap=True)
item_4 = ListItem(List=item_2, Index=bang.Branch2, Wrap=True)
item_5 = ListItem(List=item_2, Index=bang.Branch1, Wrap=True)

# ---- group: Show
number_slider = Slider(3, range=0..10)
# Visualisation
swatch = ColourSwatch(SwatchColor=RGB(0, 0, 0))
dots = DotDisplay(Point=item_3, Colour=swatch, Size=number_slider)
dots_2 = DotDisplay(Point=item_5, Colour=ColourSwatch(SwatchColor=RGB(255, 255, 255)), Size=number_slider)
dots_3 = DotDisplay(Point=item_4, Colour=ColourSwatch(SwatchColor=RGB(13, 255, 166)), Size=number_slider)

# ----
item_6 = ListItem(List=item, Index=bang.Branch0, Wrap=True)  # disabled
# Extract the corresponding mesh and boundary curves (Slow)
mjoin = MeshJoin(Meshes=item_6)
medges = MeshEdges(Mesh=mjoin)  # -> NakedEdges, InteriorEdges, NonManifoldEdges
join = JoinCurves(Curves=medges.NakedEdges, Preserve=False)
len = Length(Curve=join)
sort = SortList(Keys=len, ValuesA=join)  # -> Keys, reverse(ValuesA)
item_7 = ListItem(List=sort.ValuesA, Index=0, Wrap=True)  # -> Item, Item1, Item2
# Visualisation
merge = Merge(Data1=item_7.Item, Data2=item_7.Item1, Data3=item_7.Item2)

item_8 = ListItem(List=item, Index=bang.Branch1, Wrap=True)  # disabled
mjoin_2 = MeshJoin(Meshes=item_8)
medges_2 = MeshEdges(Mesh=mjoin_2)  # -> NakedEdges, InteriorEdges, NonManifoldEdges
join_2 = JoinCurves(Curves=medges_2.NakedEdges, Preserve=False)
len_2 = Length(Curve=join_2)
sort_2 = SortList(Keys=len_2, ValuesA=join_2)  # -> Keys, reverse(ValuesA)
item_9 = ListItem(List=sort_2.ValuesA, Index=0, Wrap=True)

item_10 = ListItem(List=item, Index=bang.Branch2, Wrap=True)  # disabled
mjoin_3 = MeshJoin(Meshes=item_10)
medges_3 = MeshEdges(Mesh=mjoin_3)  # -> NakedEdges, InteriorEdges, NonManifoldEdges
join_3 = JoinCurves(Curves=medges_3.NakedEdges, Preserve=False)
len_3 = Length(Curve=join_3)
sort_3 = SortList(Keys=len_3, ValuesA=join_3)  # -> Keys, reverse(ValuesA)
item_11 = ListItem(List=sort_3.ValuesA, Index=0, Wrap=True)
